test file "DisturbanceModel"

suite "Disturbance Tests"

  case "Disturbance Testing" [baseline]
    model MPC3DoF
    parameter set "Parameter Set 1":
      enable_turbulence = true (off)  % model workspace
      TurbProb = 10^-2 - Light  % mask workspace, MPC3DoF/Disturbance/Turbulence/Von Karman Wind Turbulence Model (Continuous (+q +r))
      W20 = 4  % mask workspace, MPC3DoF/Disturbance/Turbulence/Von Karman Wind Turbulence Model (Continuous (+q +r))
      Wdeg = 90  % mask workspace, MPC3DoF/Disturbance/Turbulence/Von Karman Wind Turbulence Model (Continuous (+q +r))
    iteration script:
      W20 = 0.1:5:10;  % issue with recognizing variables
      Wdeg = 0:90:360;

      start = 2 * 10^-1;
      stop = 10^-6;
      step_factor = 10;
      TurbProb = start ./ step_factor.^(0:3:6);


      %% Iterate over controller types
      controller_types = [ControllerType.CasADi, ...
                          ControllerType.CasADi_freetf, ...
                          ControllerType.CasADi_delay, ...
                          ControllerType.CasADi_freetf_delay];

      controller_types = controller_types(1);

      for c = 1 : numel(controller_types)
          for ws = 1 : numel(W20)
              for wd = 1 : numel(Wdeg)
                  for p = 1 : numel(TurbProb)
                      testItr = sltestiteration(); %new test iteration
                      setVariable(testItr,'Name','controller_type','Source','model workspace', 'Value', controller_types(c));
                      setVariable(testItr,'Name','W20','Source','model workspace', 'Value', W20(ws));
                      setVariable(testItr,'Name','Wdeg','Source','model workspace', 'Value', Wdeg(wd));
                      setVariable(testItr,'Name','TurbProb','Source','model workspace', 'Value', TurbProb(p));
                      % Register the iteration to run in this test case (not sure if this is formatted correctly)
                      addIteration(sltest_testCase, testItr, sprintf("Wind_Speed_%.3f %s, Wind_direction_%.3f %s, Probability_of_Turbulence_%.3f %s", W20(ws), Wdeg(wd), TurbProb(p), controller_types(c)));

                  end
              end
          end
         % addIteration(sltest_testCase, testItr, sprintf("Wind_Speed_%.3f %s, Wind_direction_%.3f %s, Probability_of_Turbulence_%.3f %s", W20(ws), Wdeg(wd), TurbProb(p), controller_types(c)));
      end