test file "DelayModel"

suite "Delay Tests"
  cleanup callback:
    save("test_suite.mat","sltest_testSuite")

  case "Delays Testing" [simulation]
    model MPC3DoF, stop time 40
    parameter set "Parameter Set 1":
      controller_type = ControllerType.CasADi_delay  % model workspace
      x0 = [100 100 0 0 1.5707963267949 0]  % model workspace
      xf = [0 0 0 0 1.5707963267949 0]  % model workspace
      enable_turbulence = false  % model workspace
      optimization_time = 0.3  % model workspace
    assessment "Small Error": At any point of time, whenever true==true is true then, with a delay of at most 39, Error < 0.8 must be true
    assessment "Ground Hit": At any point of time, GroundHitStop == false(whenever true==true is true then, with a delay of at most 39, Error < 0.8 must be true) must be true
      GroundHitStop: signal MPC3DoF/Ground Hit, port 1
      Error: signal MPC3DoF/Dot Product, port 1
    iteration script:
      %% Iterate over various delay times
      %%increment most likely by 0.1 seconds.
      delay = 0.1:0.1:3;

      %% Iterate over controller types
      controller_types = [ControllerType.CasADi, ...
                          ControllerType.CasADi_freetf, ...
                          ControllerType.CasADi_delay, ...
                          ControllerType.CasADi_freetf_delay];

      % Create each iteration
      for c = 1 : numel(controller_types)
          for d = 1 : numel(delay)
              % Set up a new iteration object
              testItr = sltestiteration();

              % Set iteration settings
              % - controller type has to be first for the
              %   ReadControllerTestResults.m function to work
              setVariable(testItr,'Name','controller_type','Source','model workspace', 'Value', controller_types(c));
              setVariable(testItr,'Name','optimization_time','Source','model workspace', 'Value', delay(d));

              % Register the iteration to run in this test case
              addIteration(sltest_testCase, testItr, sprintf("Delay_%.3f %s", delay(d), controller_types(c)));
          end
      end