test file "InitialTrajectoryChangesModel"

suite "Testing V,R"

  case "New Test Case 1" [baseline]
    model MPC3DoF
    iteration script:
      % For my own personal list:

      % v1, v2, r1, r2, r1, r2, (w is ang velocity?)
      %% Iterating through initial position and velocity.

      rng("default")
      %changes
      v1 = 0:10:50;
      v2 = randi(100,1,1); % Random # between 0 and 100 - might change to 50, etc.


      r1 = 0:0.1:0.5;
      r2 = rand *0.5;

      % may include v3, r3.


      %% Iterate over controller types
      controller_types = [ControllerType.CasADi, ...
                          ControllerType.CasADi_freetf, ...
                          ControllerType.CasADi_delay, ...
                          ControllerType.CasADi_freetf_delay];

      % Create each iteration
      for c = 1 : numel(controller_types)
          for v_1 = 1:numel(v1)
              for r_1 = 1:numel(r1)
              % Set up a new iteration object
                  testItr = sltestiteration();
                  v_2 = v2;
                  r_2 = r2;
                  setVariable(testItr,'Name','controller_type','Source','model workspace', 'Value', controller_types(c));
                  setVariable(testItr,'Name','v1','Source','model workspace', 'Value', v1(v_1));
                  setVariable(testItr, 'Name', 'v1', 'Source', 'model workspace', 'Value', r1(r_1));
                  setVariable(testItr,'Name','v2','Source','model workspace', 'Value', v_2);
                  setVariable(testItr,'Name','v2','Source','model workspace', 'Value', r_2);

              % Register the iteration to run in this test case
                  addIteration(sltest_testCase, testItr, sprintf("Position Offset_%.3f %s", r1(r_1), controller_types(c)));
                  addIteration(sltest_testCase, testItr, sprintf("Velocity Offset_%.3f %s", v1(v_1), controller_types(c)));

              end
          end
      end

suite "Testing Angle, W"

  case "New Test Case 1" [baseline]
    model MPC3DoF
    iteration script:
      % For my own personal list:

      % theta1, 2, 3; w1, 2,3
      % a good question- are these x, y, z angles? why are there 3?

      rng("default")
      %changes
      theta1= 0:10:90;
      %theta2 = randi(180,1,1); % Random # between 0 and 180 - might change to 50, etc.


      w1 = 0:0.1:0.5;
      w2 = rand *0.5;

      % may include v3, r3.


      %% Iterate over controller types
      controller_types = [ControllerType.CasADi, ...
                          ControllerType.CasADi_freetf, ...
                          ControllerType.CasADi_delay, ...
                          ControllerType.CasADi_freetf_delay];

      % Create each iteration
      for c = 1 : numel(controller_types)
          for theta_1 = 1:numel(theta1)
              for w_1 = 1:numel(w1)
              % Set up a new iteration object
                  testItr = sltestiteration();
                 % theta_2 = theta2;
                  w_2 = w2;
                  setVariable(testItr,'Name','controller_type','Source','model workspace', 'Value', controller_types(c));
                  setVariable(testItr,'Name','w1','Source','model workspace', 'Value', w1(w_1));
                  setVariable(testItr, 'Name', 'theta1', 'Source', 'model workspace', 'Value', theta1(theta_1));
                  setVariable(testItr,'Name','w2','Source','model workspace', 'Value', w_2);


              % Register the iteration to run in this test case
                  addIteration(sltest_testCase, testItr, sprintf("Angle offset_%.3f %s", theta1(theta_1), controller_types(c)));
                  addIteration(sltest_testCase, testItr, sprintf("Angular Velocity offset_%.3f %s", w1(w_1), controller_types(c)));

              end
          end
      end

suite "Test 3"

  case "test lol" [baseline]
    model MPC3DoF
    iteration script:
      %test script for initial traj

      %r1, r2 (horizontal)
      %r1 and r2 use the same array.
      r_l = 0;
      r_u = 10;
      r_arr = r_l + (r_u - r_l) * rand(1,10);
      % r3 (up)
      r3_l = 5;
      r3_u = 15;
      r3_arr = r3_l + (r3_u - r3_l) * rand(1,10);
      %v1, v2. use the same array.
      v_l = 0;
      v_u = 20;
      v_arr = v_l + (v_u - v_l) * rand(1,10);
      %v3 (up)
      v3_l = 10;
      v3_u = 100;
      v3_arr = v3_l + (v3_u - v3_l) * rand(1,10);
      %theta
      tl = 0;
      tu = 180;
      theta_arr = tl + (tu - tl) * rand(1,10);
      % THERE IS 3 THETAS LMAOO
      % will need angular later prob (w)

      controller_types = [ControllerType.CasADi, ...
                          ControllerType.CasADi_freetf, ...
                          ControllerType.CasADi_delay, ...
                          ControllerType.CasADi_freetf_delay];

      % Create each iteration
      for c = 1 : numel(controller_types)
          for i = 1:numel(r_arr, r3_arr, v_arr, v3_arr, theta_arr)

              testItr = sltestiteration();
              setVariable(testItr,'Name','controller_type','Source','model workspace', 'Value', controller_types(c));
              setVariable(testItr,'Name','r1','Source','model workspace', 'Value', r_arr(i));
              setVariable(testItr,'Name','r2','Source','model workspace', 'Value', r_arr(i));
              setVariable(testItr,'Name','r3','Source','model workspace', 'Value', r3_arr(i));
              setVariable(testItr,'Name','v1','Source','model workspace', 'Value', v_arr(i));
              setVariable(testItr,'Name','v3','Source','model workspace', 'Value', v_arr(i));
              setVariable(testItr,'Name','v3','Source','model workspace', 'Value', v3_arr(i));
              setVariable(testItr,'Name','theta','Source','model workspace', 'Value', theta_arr(i));


              % Register the iteration to run in this test case
              addIteration(sltest_testCase, testItr, sprintf("R_1%.3f %s","R_2%.3f %s", "R_3%.3f %s", "V_1%.3f %s","V_2%.3f %s","V_3%.3f %s","Theta%.3f %s", r1, r2, r3, v1,v2,v3,theta, controller_types(c)));
          end
      end